# Grasshopper definition sitefit_old3.ghx (Grasshopper 1.0.8)

construct_point = ConstructPoint(XCoordinate="0", YCoordinate="0", ZCoordinate="0")
unit_x = UnitX(Factor="50")
move = Move(Geometry=construct_point, Motion=unit_x)  # -> Geometry, Transform
line = Line(StartPoint=construct_point, EndPoint=move.Geometry)
curve = Curve(line)
