# Grasshopper definition sitefit_old4.ghx (Grasshopper 1.0.8)

rotation_spec = Panel("{\"min\":0,\"max\":90,\"step\":30}")
control_point_count = Slider(10, range=0..10)
variant_riešenia = Slider(0, range=0..50)
grid_step = Slider(3, range=0..1000)
seed = Slider(42, range=0..1000)
parcel_polygon = Curve(<curve referenced from the Rhino model>)
house_polygon = Curve(<curve referenced from the Rhino model>)
text = Text(seed)
python_3_script = Python3Script(
    parcel_polygon=parcel_polygon,
    house_polygon=house_polygon,
    rotation_spec=rotation_spec,
    grid_step=grid_step,
    seed=text,
    control_point_count=control_point_count)  # -> x, A, B, C, D; inputs parcel_polygon: Curve, house_polygon: Curve
#   port parcel_polygon: asdasdasdacgaeftzetgdcv
# ---------- python_3_script: Python ----------
import json
import random
from Rhino.Geometry import Point3d, Vector3d, Transform, Plane, AreaMassProperties, PointContainment


def sitefit_polygon(parcel_curve, house_curve, grid_step, seed, control_pt_count):
    debug_info = []

    # --- Validation ---
    if parcel_curve is None or not parcel_curve.IsClosed:
        debug_info.append("❌ ERROR: Parcel must be a closed curve")
        return [], [], [], debug_info
    if house_curve is None or not house_curve.IsClosed:
        debug_info.append("❌ ERROR: House must be a closed curve")
        return [], [], [], debug_info

    parcel_bounds = parcel_curve.GetBoundingBox(True)
    props = AreaMassProperties.Compute(house_curve)
    if not props:
        debug_info.append("❌ ERROR: Cannot compute house properties")
        return [], [], [], debug_info

    house_centroid = props.Centroid
    grid_step = max(grid_step, 0.1)
    control_pt_count = max(int(control_pt_count), 3)
    random.seed(seed)

    # --- Precompute evenly spaced house points along the perimeter ---
    segment_length = house_curve.GetLength() / control_pt_count
    params = house_curve.DivideByLength(segment_length, True)  # returns parameter list
    house_points = []

    if params:
        for t in params:
            house_points.append(house_curve.PointAt(t))
    else:
        # Fallback if division fails
        for i in range(control_pt_count):
            house_points.append(
                house_curve.PointAtNormalizedLength(float(i) / control_pt_count)
            )

    debug_info.append(f"Control points along house: {len(house_points)}")
    debug_info.append(f"Grid step: {grid_step}")

    transforms_json = []
    kpis = []
    movement_vectors = []

    # --- Iterate over grid positions ---
    placements_tested = 0
    x = parcel_bounds.Min.X
    while x <= parcel_bounds.Max.X + 1e-6:
        y = parcel_bounds.Min.Y
        while y <= parcel_bounds.Max.Y + 1e-6:
            placements_tested += 1

            # Translation to move house centroid to current grid point
            target_pt = Point3d(x, y, 0)
            translation_vec = Vector3d(target_pt - house_centroid)
            t_translate = Transform.Translation(translation_vec)

            # Check all control points after translation
            inside_count = 0
            for pt in house_points:
                moved_pt = Point3d(pt)
                moved_pt.Transform(t_translate)
                contain = parcel_curve.Contains(moved_pt, Plane.WorldXY, 0.01)
                if contain == PointContainment.Inside:
                    inside_count += 1

            # KPI = fraction of control points inside
            kpi = round(inside_count / float(len(house_points)), 3)

            # Store transform info
            transform_obj = {
                "translation": {
                    "x": translation_vec.X,
                    "y": translation_vec.Y,
                    "z": translation_vec.Z,
                    "units": "m"
                },
                "rotation": {"axis": "z", "value": 0.0, "units": "deg"},
                "scale": {"uniform": 1.0}
            }
            transforms_json.append(json.dumps(transform_obj, separators=(",", ":")))
            kpis.append(kpi)
            movement_vectors.append(translation_vec)

            y += grid_step
        x += grid_step

    debug_info.append(f"Placements tested: {placements_tested}")
    debug_info.append(f"Example KPIs: {kpis[:min(10, len(kpis))]}")

    return transforms_json, kpis, movement_vectors, debug_info


# --- Grasshopper call ---
A, B, C, D = sitefit_polygon(parcel_polygon, house_polygon, grid_step, seed, control_point_count)
# ---------- end python_3_script ----------
panel = Panel(python_3_script.D)
panel_2 = Panel(python_3_script.C)
panel_3 = Panel(python_3_script.A)
panel_4 = Panel(python_3_script.B)
list_item = ListItem(List=python_3_script.C, Index=variant_riešenia, Wrap=True)
list_item_2 = ListItem(List=python_3_script.B, Index=variant_riešenia, Wrap=True)
move = Move(Geometry=house_polygon, Motion=list_item)  # -> Geometry, Transform
stream_filter = StreamFilter(Gate=list_item_2, Stream0=ColourSwatch(SwatchColor=RGB(242, 129, 0)), Stream1=ColourSwatch(SwatchColor=RGB(60, 199, 50)))
custom_preview = CustomPreview(Geometry=move.Geometry, Material=stream_filter)
