# Grasshopper definition ghlogic.ghx (Grasshopper 1.0.8)
# SiteFit v1.1.0 Debug - Minimal test

input_value = Number()
_10 = Number()
addition = Addition(A=input_value, B=_10, Category="Maths", SubCategory="Operators")
output_value = Number(addition)
